# Grasshopper definition FF2Rhino.gh (Grasshopper 0.9.76)

# ---- group: Path
panel = Panel("C:\\Users\\Public\\Music\\debug\\INormal_")
panel_2 = Panel("C:\\Users\\Public\\Music\\debug\\IStart.txt")
panel_3 = Panel("C:\\Users\\Public\\Music\\debug\\IEnd.txt")

# ---- group: order
number_slider = Slider(73, range=0..142)

# ----
read_file = ReadFile(File=panel_3, PerLineParse=True)
read_file_2 = ReadFile(File=panel_2, PerLineParse=True)
integer = Integer(0)
integer_2 = Integer(number_slider)
point = Point(read_file_2)
point_2 = Point(read_file)
line = Line(StartPoint=point, EndPoint=point_2)
construct_domain = ConstructDomain(DomainStart=integer, DomainEnd=integer_2)
concatenate = Concatenate(Fragment_A=panel, Fragment_B=integer_2, A=".txt")
sub_list = SubList(List=line, Domain=construct_domain, Wrap=True)  # -> List, Index
number = Number(0.5)
colour_picker = ColourPicker(PickedColour=RGB(198, 199, 207))
pipe = Pipe(Curve=sub_list.List, Radius=number, Caps=0)  # -> flatten(Pipe)
list_item = ListItem(List=line, Index=integer_2, Wrap=True)
custom_preview = CustomPreview(Geometry=pipe, Shader=colour_picker)
explode = Explode(Curve=list_item, Recursive=True)  # -> Segments, Vertices
read_file_3 = ReadFile(File=concatenate, PerLineParse=True)
vector = Vector(read_file_3)
list_length = ListLength(List=vector)
subtraction = Subtraction(A=list_length, B=1)

# ---- group: 方向
number_slider_2 = Slider(0, range=0..100)
panel_4 = Panel(subtraction)

# ----
list_item_2 = ListItem(List=vector, Index=number_slider_2, Wrap=True)
list_item_3 = ListItem(List=explode.Vertices, Index=0, Wrap=True)  # -> Item, Item1
point_3 = Point(list_item_3.Item1)
point_4 = Point(list_item_3.Item)
line_2 = Line(StartPoint=point_4, EndPoint=point_3)
negative = Negative(Value=list_item_2)
radians = Radians(Degrees=Slider(40, range=0..100))
tangent = Tangent(Value=radians)
number_slider_3 = Slider(20, range=0..100)
number_slider_4 = Slider(100, range=0..1000)
plane_normal = PlaneNormal(Origin=point_4, ZAxis=negative)
negative_2 = Negative(Value=negative)
plane_normal_2 = PlaneNormal(Origin=point_3, ZAxis=negative)
multiplication = Multiplication(A=tangent, B=number_slider_3)
plane_normal_3 = PlaneNormal(Origin=point_4, ZAxis=negative_2)
plane_normal_4 = PlaneNormal(Origin=point_3, ZAxis=negative_2)
multiplication_2 = Multiplication(A=number_slider_3, B=negative)
negative_3 = Negative(Value=multiplication_2)
cone = Cone(Base=plane_normal_2, Radius=multiplication, Length=number_slider_3)  # -> Cone, Tip
cone_2 = Cone(Base=plane_normal, Radius=multiplication, Length=number_slider_3)  # -> Cone, Tip
vector_2pt = Vector2Pt(PointA=point_4, PointB=point_3, Unitize=False)  # -> Vector, Length
cylinder = Cylinder(Base=plane_normal_3, Radius=multiplication, Length=number_slider_4)
cylinder_2 = Cylinder(Base=plane_normal_4, Radius=multiplication, Length=number_slider_4)
unit_vector = UnitVector(Vector=vector_2pt.Vector)
move = Move(Geometry=[cone_2.Cone, cone.Cone], Motion=negative_3)  # -> Geometry, Transform
move_2 = Move(Geometry=[point_4, point_3], Motion=negative_3)  # -> Geometry, Transform
move_3 = Move(Geometry=[cylinder, cylinder_2], Motion=negative_3)  # -> Geometry, Transform
cross_product = CrossProduct(VectorA=unit_vector, VectorB=negative, Unitize=False)  # -> Vector, Length
unit_vector_2 = UnitVector(Vector=cross_product.Vector)
multiplication_3 = Multiplication(A=multiplication, B=unit_vector_2)
negative_4 = Negative(Value=multiplication_3)
multiplication_4 = Multiplication(A=negative_2, B=number_slider_4)
move_4 = Move(Geometry=move_2.Geometry, Motion=negative_4)  # -> Geometry, Transform
move_5 = Move(Geometry=move_2.Geometry, Motion=multiplication_3)  # -> Geometry, Transform
data = Data([point_4, point_3])
list_item_4 = ListItem(List=move_5.Geometry, Index=0, Wrap=True)  # -> Item, Item1
list_item_5 = ListItem(List=data, Index=0, Wrap=True)  # -> Item, Item1
list_item_6 = ListItem(List=move_4.Geometry, Index=0, Wrap=True)  # -> Item, Item1
move_6 = Move(Geometry=[move_4.Geometry, move_5.Geometry], Motion=multiplication_4)  # -> Geometry, Transform
list_item_7 = ListItem(List=move_6.Geometry, Index=0, Wrap=True)  # -> Item, Item1, Item2, Item3
_4point_surface = _4PointSurface(CornerA=list_item_6.Item, CornerB=list_item_5.Item, CornerC=list_item_5.Item1, CornerD=list_item_6.Item1)
_4point_surface_2 = _4PointSurface(CornerA=list_item_4.Item, CornerB=list_item_5.Item, CornerC=list_item_5.Item1, CornerD=list_item_4.Item1)
_4point_surface_3 = _4PointSurface(CornerA=list_item_6.Item, CornerB=list_item_7.Item, CornerC=list_item_7.Item1, CornerD=list_item_6.Item1)
_4point_surface_4 = _4PointSurface(CornerA=list_item_4.Item, CornerB=list_item_7.Item2, CornerC=list_item_7.Item3, CornerD=list_item_4.Item1)
